# Dynamo custom node Fibonacci.dyf (Dynamo 2.0.1.5055)
# category: JetPack G

integer = Input(integer: int)
python_script = Python(IN[0]=integer)
# ---------- python_script.python (15 lines) ----------
n = IN[0]

if n < 0:
	pass
elif n == 0:
	result = 0
else:
	a = 0
	b = 1
	for i in range(2, n):
	    c = a + b
	    a, b = b, c
	result =  a + b 

OUT = result
# ----------------------------------------
Integer = Output(python_script)
