# Dynamo custom node Application.OpenDocumentFile.dyf (Dynamo 2.0.1.5055)
# category: JetPack X.Revit
# Open document by file path

filePath = Input(filePath: string)  # File Path
python_script = Python(IN[0]=filePath)
# ---------- python_script.python (20 lines) ----------
import clr

clr.AddReference("RevitServices")
import RevitServices
from RevitServices.Persistence import DocumentManager
from RevitServices.Transactions import TransactionManager

clr.AddReference("RevitAPI")
clr.AddReference("RevitAPIUI")
from Autodesk.Revit.DB import *

# Document from file path
uiapp = DocumentManager.Instance.CurrentUIApplication
app = uiapp.Application
filePath = FilePath(IN[0])
options = OpenOptions()

docFromPath = app.OpenDocumentFile(filePath, options)

OUT = docFromPath
# ----------------------------------------
Document = Output(python_script)
