# Dynamo custom node Document.Close.dyf (Dynamo 2.0.1.5055)
# category: JetPack X.Revit.Application
# Save and close document

document = Input(document: System.Object)  # Document for save and close
python_script = Python(IN[0]=document)
# ---------- python_script.python (25 lines) ----------
# Copyright(c) 2018, Oleg (Brutich) Zholobov
# @JetPack, http://www.Oleg-Zholobov.com

import clr

# Import DocumentManager
clr.AddReference("RevitServices")
import RevitServices
from RevitServices.Persistence import DocumentManager

# Import RevitAPI
clr.AddReference("RevitAPI")
import Autodesk
from Autodesk.Revit.DB import *

doc = UnwrapElement(IN[0])
report = ''

try:
	doc.Close()
	report = "Successfully"
except Exception as e:
	report = "Error: {0}".format(e)
	
OUT = report
# ----------------------------------------
Report = Output(python_script)
