# Dynamo custom node Document.Current.dyf (Dynamo 2.0.1.5055)
# category: JetPack X.Revit.Application.Query

python_script = Python()
# ---------- python_script.python (7 lines) ----------
import clr

clr.AddReference("RevitServices")
import RevitServices
from RevitServices.Persistence import DocumentManager

OUT = DocumentManager.Instance.CurrentDBDocument
# ----------------------------------------
Document = Output(python_script)
