# Dynamo custom node Document.DeleteElement.dyf (Dynamo 2.0.1.5055)
# category: JetPack X.Revit.Application

element = Input(element: Revit.Elements.Element[]..[])
flatten = List.Flatten(list=element)
code_block = CodeBlock { false; }
clean = List.Clean(list=flatten, preserveIndices=code_block)
uniqueItems = List.UniqueItems(list=clean)
document_System_Object = Input(document: System.Object: var[]..[])
python_script = Python(IN[0]=uniqueItems, IN[1]=document_System_Object)
# ---------- python_script.python (53 lines) ----------
# Copyright(c) 2018, Oleg (Brutich) Zholobov
# @JetPack, http://www.Oleg-Zholobov.com

import clr

# Import DocumentManager and TransactionManager
clr.AddReference("RevitServices")
import RevitServices
from RevitServices.Persistence import DocumentManager
from RevitServices.Transactions import TransactionManager

# Import RevitAPI
clr.AddReference("RevitAPI")
import Autodesk
from Autodesk.Revit.DB import *

doc = UnwrapElement(IN[1])
uiapp = DocumentManager.Instance.CurrentUIApplication
app = uiapp.Application

from System.Collections.Generic import *

#The inputs to this node will be stored as a list in the IN variable.
dataEnteringNode = IN
elems = UnwrapElement(IN[0])

elemIds = []
nErrors = 0

for elem in elems:
	try:
		elemIds.append(elem.Id)
	except AttributeError:
		nErrors += 1
		pass

#Transaction Start
TransactionManager.Instance.EnsureInTransaction(doc)

nDeleted = 0
for item in elemIds:
	try:
		doc.Delete(item)
		nDeleted += 1
	except:
		nErrors += 1
		pass
		
#Transaction End
TransactionManager.Instance.TransactionTaskDone()
	
#Assign your output to the OUT variable
OUT = [doc, "Successfully deleted elements: {0}.\nErrors: {1}".format(nDeleted, nErrors)]
# ----------------------------------------
code_block_2 = CodeBlock(item=python_script) { item[0]; item[1]; }
Report = Output(code_block_2.out1)
Document = Output(code_block_2.out0)
