# Dynamo custom node Document.ElementSetName.dyf (Dynamo 2.0.1.5055)
# category: JetPack X.Revit.Application

document = Input(document: System.Object)
elements = Input(elements: Revit.Elements.Element[])
names = Input(names: string[])
python_script = Python(IN[0]=document, IN[1]=elements, IN[2]=names)
# ---------- python_script.python (34 lines) ----------
import clr
clr.AddReference('RevitAPI')
from Autodesk.Revit.DB import *
import Autodesk

clr.AddReference("RevitServices")
import RevitServices
from RevitServices.Persistence import DocumentManager
from RevitServices.Transactions import TransactionManager


doc = UnwrapElement(IN[0])

elements = UnwrapElement(IN[1])
names = UnwrapElement(IN[2])
reports = []


t = Transaction(doc)
t.Start('Set Element Name')	

for i in range(len(elements)):
	try:
		elements[i].Name = names[i]		
		reports.append("Successfully")
				
	except Exception as e:
		reports.append("Error: {0}".format(e))
		pass
	
t.Commit()

#Assign your output to the OUT variable.
OUT = [doc, reports]
# ----------------------------------------
code_block = CodeBlock(item=python_script) { item[0]; item[1]; }
Report = Output(code_block.out1)
Document = Output(code_block.out0)
