# Dynamo custom node Document.GetAllElementsOfType.dyf (Dynamo 2.0.1.5055)
# category: JetPack X.Revit.Application
# Return all elements of type in document

document = Input(document: System.Object)
elementType = Input(elementType: System.Type)
python_script = Python(IN[0]=document, IN[1]=elementType)
# ---------- python_script.python (16 lines) ----------
import clr
clr.AddReference('RevitAPI')
from Autodesk.Revit.DB import *
import Autodesk

clr.AddReference("RevitServices")
import RevitServices
from RevitServices.Persistence import DocumentManager

doc = UnwrapElement(IN[0])
elemType = UnwrapElement(IN[1])

collector = FilteredElementCollector(doc)
elems = collector.OfClass(elemType).ToElements()

OUT = elems
# ----------------------------------------
Elements = Output(python_script)
