# Dynamo custom node Document.SetGlobalParameterValueByName.dyf (Dynamo 2.0.1.5055)
# category: JetPack X.Revit.Application

document = Input(document: System.Object)
globalParameterName = Input(globalParameterName: string)
globalParameterValue = Input(globalParameterValue: var)
python_script = Python(IN[0]=document, IN[1]=globalParameterName, IN[2]=globalParameterValue)
# ---------- python_script.python (46 lines) ----------
# Copyright(c) 2018, Oleg (Brutich) Zholobov
# @JetPack, http://www.Oleg-Zholobov.com

import clr

# Import DocumentManager
clr.AddReference("RevitServices")
import RevitServices
from RevitServices.Persistence import DocumentManager

# Import RevitAPI
clr.AddReference("RevitAPI")
import Autodesk
from Autodesk.Revit.DB import *

# Document
doc = UnwrapElement(IN[0])

# Set Global Parameter by Name
report = ''

gpName = IN[1]
gpParamValue = IN[2]

gpId = GlobalParametersManager.FindByName(doc, gpName)

if gpId.ToString() == '-1':
	report = 'Error: Parameter "{0}" not found'.format(gpName)
else:		
	t = Transaction(doc)
	t.Start('Set Global Parameter by Name')
	
	try:
		gp = doc.GetElement(gpId)
		gpvalue = gp.GetValue()
		gpvalue.Value = gpParamValue
		gp.SetValue(gpvalue)
		
		report = "Successfully"
	except Exception as e:
		report = "Error: {0}".format(e)
	
	t.Commit();

# Output
OUT =[doc, report]
# ----------------------------------------
code_block = CodeBlock(item=python_script) { item[0]; item[1]; }
Report = Output(code_block.out1)
Document = Output(code_block.out0)
