# Dynamo custom node All Elements by Workset.dyf (Dynamo 2.0.1.5055)
# category: JetPack.Revit.Selection
# Returns elements of given workset

workset = Input(workset: System.Object)
python_script = Python(IN[0]=workset)
# ---------- python_script.python (20 lines) ----------
import clr
clr.AddReference('RevitAPI')
from Autodesk.Revit.DB import *
import Autodesk

clr.AddReference("RevitServices")
import RevitServices
from RevitServices.Persistence import DocumentManager

doc = DocumentManager.Instance.CurrentDBDocument
workset = UnwrapElement(IN[0])


elem_coll = FilteredElementCollector(doc)
filter = ElementWorksetFilter(workset.Id)

worksetElemsfounds = elem_coll.WherePasses(filter).ToElements()


OUT = worksetElemsfounds
# ----------------------------------------
Elements = Output(python_script)
