# Dynamo custom node Element.SetSelection.dyf (Dynamo 2.0.1.5055)
# category: JetPack.Revit.Elements
# Selecting elements in the entire Revit document

element = Input(element: Revit.Elements.Element[]..[])
flatten = List.Flatten(list=element)
code_block = CodeBlock { false; }
clean = List.Clean(list=flatten, preserveIndices=code_block)
uniqueItems = List.UniqueItems(list=clean)
python_script = Python(IN[0]=uniqueItems)
# ---------- python_script.python (31 lines) ----------
import clr
clr.AddReference("RevitAPI")
clr.AddReference("RevitAPIUI")
import Autodesk
from Autodesk.Revit.UI import *
from Autodesk.Revit.DB import *
clr.AddReference("RevitServices")
import RevitServices
from RevitServices.Persistence import DocumentManager
clr.AddReference("RevitNodes")
import Revit
# clr.ImportExtensions(Revit.Elements)
from System.Collections.Generic import *

elems = UnwrapElement(IN[0])

elemIds = []
nErrors = 0

for elem in elems:
	try:
		elemIds.append(elem.Id)
	except AttributeError:
		nErrors += 1
		pass
 	
uidoc = DocumentManager.Instance.CurrentUIDocument
uidoc.Selection.SetElementIds(List[ElementId](elemIds))

# Just for fun - give it to the output!
OUT = "{0} selected elements, {1} errors".format(len(elemIds), nErrors)
# ----------------------------------------
Report = Output(python_script)
