# Dynamo custom node FamilyInstance.IsFlipped.dyf (Dynamo 2.0.1.5055)
# category: JetPack.Revit.Elements.Query
# Determines the if the given family Instances are flipped. Can be used for set door handing.

familyInstance = Input(familyInstance: Revit.Elements.FamilyInstance)
python_script = Python(IN[0]=familyInstance)
# ---------- python_script.python (10 lines) ----------
import clr
clr.AddReference("RevitNodes")
import Revit
clr.ImportExtensions(Revit.Elements)

#input assigned the IN variable
element = UnwrapElement(IN[0])

#output assigned the OUT variable
OUT = element.HandFlipped
# ----------------------------------------
python_script_2 = Python(IN[0]=familyInstance)
# ---------- python_script_2.python (10 lines) ----------
import clr
clr.AddReference("RevitNodes")
import Revit
clr.ImportExtensions(Revit.Elements)

#input assigned the IN variable
element = UnwrapElement(IN[0])

#output assigned the OUT variable
OUT = element.FacingFlipped
# ----------------------------------------
xor = Math.Xor(a=python_script, b=python_script_2)
bool = Output(xor)
