# Dynamo custom node IsHiddenOnView.dyf (Dynamo 2.0.1.5055)
# category: JetPack.Revit.Elements.Element.Query

element = Input(element: Revit.Elements.Element)
view = Input(view: Revit.Elements.Views.View)
python_script = Python(IN[0]=element, IN[1]=view)
# ---------- python_script.python (4 lines) ----------
element = UnwrapElement(IN[0])
view = UnwrapElement(IN[1])

OUT = element.IsHidden(view)
# ----------------------------------------
Is_Hidden = Output(python_script)
