# Dynamo graph PrismSolidConstruction.dyn (Dynamo 2.0.1.5055)

warnings = Custom[Warnings]()
python_script = Python()  # unwired: IN[0]
# ---------- python_script.python (57 lines) ----------
#Based on
#https://thebuildingcoder.typepad.com/blog/2015/07/intersect-solid-filter-avf-and-directshape-for-debugging.html

import clr
clr.AddReference("RevitServices")
import RevitServices
from RevitServices.Persistence import DocumentManager

clr.AddReference('ProtoGeometry')
from Autodesk.DesignScript.Geometry import *

# Import ToDSType(bool) extension method
clr.AddReference('RevitNodes')
import Revit
clr.ImportExtensions(Revit.Elements)
# Import ToProtoType() extension method
clr.ImportExtensions(Revit.GeometryConversion)

clr.AddReference("RevitAPI")
clr.AddReference("RevitAPIUI")
import Autodesk
from Autodesk.Revit.UI import *
from Autodesk.Revit.DB import *

from System.Collections.Generic import *


def CreateCube(d):
	return CreateRectangularPrism(XYZ.Zero, d, d, d)
	
	
def CreateRectangularPrism(center, d1, d2, d3): 

    profile = []
    
    profile00 = XYZ(-d1/2, -d2/2, -d3/2)
    profile01 = XYZ(-d1/2,  d2/2, -d3/2)
    profile11 = XYZ( d1/2,  d2/2, -d3/2)
    profile10 = XYZ( d1/2, -d2/2, -d3/2)
    
    profile.Add(Line.CreateBound(profile00, profile01))
    profile.Add(Line.CreateBound(profile01, profile11))
    profile.Add(Line.CreateBound(profile11, profile10))
    profile.Add(Line.CreateBound(profile10, profile00))
    
    curveLoop = [CurveLoop.Create(profile)]
    
    options = SolidOptions(ElementId.InvalidElementId, ElementId.InvalidElementId)
    
    return GeometryCreationUtilities.CreateExtrusionGeometry(curveLoop, XYZ.BasisZ, d3, options)
    

#doc = DocumentManager.Instance.CurrentDBDocument
solid = CreateCube(100)


OUT = solid.ToProtoType(), dir(solid)
# ----------------------------------------
