# Dynamo custom node Document.SetGlobalParameterValueByName.dyf (Dynamo 2.0.1.5055)
# category: JetPack Experimental

document = Input(document: var[]..[] = current)
globalParameterName = Input(globalParameterName: var[]..[])
globalParameterValue = Input(globalParameterValue: var[]..[])
python_script = Python(IN[0]=document, IN[1]=globalParameterName, IN[2]=globalParameterValue)
# ---------- python_script.python (42 lines) ----------
import clr

# Import DocumentManager
clr.AddReference("RevitServices")
import RevitServices
from RevitServices.Persistence import DocumentManager

# Import RevitAPI
clr.AddReference("RevitAPI")
import Autodesk
from Autodesk.Revit.DB import *

# Document
inputdoc = UnwrapElement(IN[0])
if inputdoc == None:
	doc = DocumentManager.Instance.CurrentDBDocument
elif inputdoc.GetType().ToString() == "Autodesk.Revit.DB.RevitLinkInstance":
	doc = inputdoc.GetLinkDocument()
elif inputdoc.GetType().ToString() == "Autodesk.Revit.DB.Document":
	doc = inputdoc
else: doc = None

# Set Global Parameter by Name
gpName = IN[1]
gpParamValue = IN[2]
gpId = GlobalParametersManager.FindByName(doc, gpName)

t = Transaction(doc)
t.Start('Set Global Parameter by Name')

gp = doc.GetElement(gpId)

gpvalue = gp.GetValue()
gpvalue.Value = gpParamValue

gp.SetValue(gpvalue)

t.Commit();


# Output
OUT = gpvalue.Value
# ----------------------------------------
Parameter_Value = Output(python_script)
