# Dynamo custom node Element.Delete.dyf (Dynamo 2.0.1.5055)
# category: JetPack.Elements
# Delete selected elements

# group: not used
code_block = CodeBlock { Revit.Elements.Delete(elem); }  # unwired: elem

element = Input(element: var[]..[])
flatten = List.Flatten(list=element)
code_block_2 = CodeBlock { false; }
clean = List.Clean(list=flatten, preserveIndices=code_block_2)
uniqueItems = List.UniqueItems(list=clean)
delete_elems = Python(IN[0]=uniqueItems)
# ---------- delete_elems.python (53 lines) ----------
# Copyright(c) 2018, Oleg (Brutich) Zholobov
# @JetPackToolkit, http://www.Oleg-Zholobov.com

import clr

# Import DocumentManager and TransactionManager
clr.AddReference("RevitServices")
import RevitServices
from RevitServices.Persistence import DocumentManager
from RevitServices.Transactions import TransactionManager

# Import RevitAPI
clr.AddReference("RevitAPI")
import Autodesk
from Autodesk.Revit.DB import *

doc = DocumentManager.Instance.CurrentDBDocument
uiapp = DocumentManager.Instance.CurrentUIApplication
app = uiapp.Application

from System.Collections.Generic import *

#The inputs to this node will be stored as a list in the IN variable.
dataEnteringNode = IN
elems = UnwrapElement(IN[0])

elemIds = []
nErrors = 0

for elem in elems:
	try:
		elemIds.append(elem.Id)
	except AttributeError:
		nErrors += 1
		pass

#Transaction Start
TransactionManager.Instance.EnsureInTransaction(doc)

nDeleted = 0
for item in elemIds:
	try:
		doc.Delete(item)
		nDeleted += 1
	except:
		nErrors += 1
		pass
		
#Transaction End
TransactionManager.Instance.TransactionTaskDone()
	
#Assign your output to the OUT variable
OUT = "Successfully deleted elements: {0}.\nErrors: {1}".format(nDeleted, nErrors)
# ----------------------------------------
Report = Output(delete_elems)
