# Dynamo custom node Element.SetName.dyf (Dynamo 2.0.1.5055)
# category: JetPack.Elements
# Assigns a new name to an element

element = Input(element: Revit.Elements.Element[])
elementType = Element.ElementType(element=element)
name = Input(name: string[])
python_script = Python(IN[0]=elementType, IN[1]=name)
# ---------- python_script.python (20 lines) ----------
import clr
clr.AddReference("RevitServices")
import RevitServices
from RevitServices.Persistence import DocumentManager
from RevitServices.Transactions import TransactionManager
doc = DocumentManager.Instance.CurrentDBDocument


elements = list(UnwrapElement(IN[0]))
names = list(UnwrapElement(IN[1]))
i = 0

TransactionManager.Instance.EnsureInTransaction(doc)
for elems in elements:	
	elements[i].Name = names[i]
	i += 1
TransactionManager.Instance.TransactionTaskDone()

#Assign your output to the OUT variable.
OUT = elements
# ----------------------------------------
element_2 = Output(python_script)  # "element"
