# Dynamo custom node FamilyInstance.IsFlipped.dyf (Dynamo 2.0.1.5055)
# category: JetPack.Elements
# Determines the if the given family Instances are flipped. Can be used for set door handing.

familyInstance = Input(familyInstance: Revit.Elements.FamilyInstance[]..[])
handFlipped = Python(IN[0]=familyInstance)
# ---------- handFlipped.python (10 lines) ----------
import clr
clr.AddReference("RevitNodes")
import Revit
clr.ImportExtensions(Revit.Elements)

#input assigned the IN variable
element = list(UnwrapElement(IN[0]))

#output assigned the OUT variable
OUT = [ (True if elem.HandFlipped else False) for elem in element ]
# ----------------------------------------
facingFlipped = Python(IN[0]=familyInstance)
# ---------- facingFlipped.python (10 lines) ----------
import clr
clr.AddReference("RevitNodes")
import Revit
clr.ImportExtensions(Revit.Elements)

#input assigned the IN variable
element = list(UnwrapElement(IN[0]))

#output assigned the OUT variable
OUT = [ (True if elem.FacingFlipped else False) for elem in element ]
# ----------------------------------------
xor = Math.Xor(a=handFlipped, b=facingFlipped)
bool = Output(xor)
