# Dynamo custom node Point.IsInsideGeometry.dyf (Dynamo 2.0.1.5055)
# category: JetPack.Geometry
# Check if the point is inside geometry

geometry = Input(geometry: Autodesk.DesignScript.Geometry.Geometry[]..[])
point = Input(point: Autodesk.DesignScript.Geometry.Point[]..[])
tolerance = Input(tolerance: double = 0)
code_block = CodeBlock(tolerance=tolerance) { Math.Abs(tolerance); }
point_containment_test = CodeBlock(geometry=geometry, point=point, tolerance=code_block) { geometry.DistanceTo(point) <= tolerance; }
bool = Output(point_containment_test)
