# Dynamo custom node Document.FromLink.dyf (Dynamo 2.0.1.5055)
# category: JetPack X.Revit.Application.Query
# Get link document

linkInstance = Input(linkInstance: Revit.Elements.Element)
python_script = Python(IN[0]=linkInstance)
# ---------- python_script.python (17 lines) ----------
import clr

clr.AddReference("RevitServices")
import RevitServices
from RevitServices.Persistence import DocumentManager
from RevitServices.Transactions import TransactionManager

clr.AddReference("RevitAPI")
clr.AddReference("RevitAPIUI")
from Autodesk.Revit.DB import *

# Document from Link
uiapp = DocumentManager.Instance.CurrentUIApplication
app = uiapp.Application
doc = UnwrapElement(IN[0]).GetLinkDocument()

OUT = doc
# ----------------------------------------
Document = Output(python_script)
