# Dynamo custom node Document.WallTypeCompoundStructure.dyf (Dynamo 2.0.1.5055)
# category: JetPack X.Revit.Application.Query

wallType = Input(wallType: Revit.Elements.WallType)
document = Input(document: System.Object)
python_script = Python(IN[0]=wallType, IN[1]=document)
# ---------- python_script.python (44 lines) ----------
# Enable Python support and load DesignScript library
import clr
clr.AddReference('ProtoGeometry')
from Autodesk.DesignScript.Geometry import *

# Import DocumentManager and TransactionManager
clr.AddReference("RevitServices")
import RevitServices
from RevitServices.Persistence import DocumentManager
from RevitServices.Transactions import TransactionManager

# Import RevitAPI
clr.AddReference("RevitAPI")
import Autodesk
from Autodesk.Revit.DB import *

doc = UnwrapElement(IN[1])

wallType = UnwrapElement(IN[0])
structure = wallType.GetCompoundStructure()
layerCount = structure.LayerCount
firstCoreLayerInd = structure.GetLastCoreLayerIndex()
lastCoreLayerInd = structure.GetFirstCoreLayerIndex()
strMaterialInd = structure.StructuralMaterialIndex

layerFunctions = []
layerMaterials = []
layerThicknesses = []
wrappingLayers = []
isStructuralLayers = []
isFirstCoreLayer = []

for i in range(layerCount):
	layerFunctions.append(structure.GetLayerFunction(i))
	layerMaterials.append(doc.GetElement(structure.GetMaterialId(i)))
	layerThicknesses.append(structure.GetLayerWidth(i) * 304.8)
	wrappingLayers.append(structure.ParticipatesInWrapping(i))
	isStructuralLayers.append(i == strMaterialInd)
	isFirstCoreLayer.append(i == firstCoreLayerInd)

keys = ('Function', 'Material', 'Thickness', 'Is Structural', 'Is First Core Layer')
values = (layerFunctions, layerMaterials, layerThicknesses, isStructuralLayers, isFirstCoreLayer)

OUT = keys, values, doc
# ----------------------------------------
code_block = CodeBlock(si=python_script) { si[0]; si[1]; si[2]; }
code_block_2 = CodeBlock(keys=code_block.out0) { keys; }
transpose = List.Transpose(lists=code_block.out1)
byKeysValues = DesignScript.Builtin.Dictionary.ByKeysValues(keys=code_block_2, values=transpose@L2)
Structure_Info = Output(byKeysValues)
Document = Output(code_block.out2)
