# Dynamo custom node Document.Worksets.dyf (Dynamo 2.0.1.5055)
# category: JetPack X.Revit.Application.Query
# Return all available workset in a given document

document = Input(document: System.Object)
python_script = Python(IN[0]=document)
# ---------- python_script.python (22 lines) ----------
import clr
clr.AddReference('RevitAPI')
from Autodesk.Revit.DB import *
import Autodesk

clr.AddReference("RevitServices")
import RevitServices
from RevitServices.Persistence import DocumentManager

clr.AddReference('ProtoGeometry')
from Autodesk.DesignScript.Geometry import *


doc = UnwrapElement(IN[0])
worksetTable = doc.GetWorksetTable()

ws_coll = FilteredWorksetCollector(doc)
ws_kindes = [ws.Kind.ToString() for ws in ws_coll]
ws_names = [ws.Name for ws in ws_coll]
ws_ids = [ws.Id.IntegerValue for ws in ws_coll]

OUT = [ws_kindes, ws_names, ws_ids, list(ws_coll)]
# ----------------------------------------
code_block = CodeBlock(i=python_script) { kinds = i[0]; names = i[1]; IDs = i[2]; WS = i[3]; }
Kinds = Output(code_block.kinds)
Names = Output(code_block.names)
Document = Output(document)
IDs = Output(code_block.IDs)
Worksets = Output(code_block.WS)
