# Dynamo custom node Element.SetName.dyf (Dynamo 2.0.1.5055)
# category: JetPack.Revit.Elements
# Assigns a new name to an element

element = Input(element: Revit.Elements.Element[])
name = Input(name: string[])
python_script = Python(IN[0]=element, IN[1]=name)
# ---------- python_script.python (34 lines) ----------
import clr
clr.AddReference('RevitAPI')
from Autodesk.Revit.DB import *
import Autodesk

clr.AddReference("RevitServices")
import RevitServices
from RevitServices.Persistence import DocumentManager
from RevitServices.Transactions import TransactionManager


doc = DocumentManager.Instance.CurrentDBDocument

elements = UnwrapElement(IN[0])
names = UnwrapElement(IN[1])
reports = []


t = Transaction(doc)
t.Start('Set Element Name')	

for i in range(len(elements)):
	try:
		elements[i].Name = names[i]		
		reports.append("Successfully")
				
	except Exception as e:
		reports.append("Error: {0}".format(e))
		pass
	
t.Commit()

# Just for fun - give it to the output!
OUT = reports
# ----------------------------------------
Report = Output(python_script)
