# Dynamo custom node FamilyInstance.ChangeType.dyf (Dynamo 2.0.1.5055)
# category: JetPack.Revit.Elements

familyInstance = Input(familyInstance: Revit.Elements.FamilyInstance[])
type = Input(type: Revit.Elements.FamilyType)
changeType = Python(IN[0]=familyInstance, IN[1]=type)
# ---------- changeType.python (24 lines) ----------
import clr

# Import DocumentManager and TransactionManager
clr.AddReference("RevitServices")
import RevitServices
from RevitServices.Persistence import DocumentManager
from RevitServices.Transactions import TransactionManager


doc = DocumentManager.Instance.CurrentDBDocument


instances = UnwrapElement(IN[0])
anotherType = UnwrapElement(IN[1])


#Transaction Start
TransactionManager.Instance.EnsureInTransaction(doc)
[inst.ChangeTypeId(anotherType.Id) for inst in instances]
#Transaction End
TransactionManager.Instance.TransactionTaskDone()


OUT = instances
# ----------------------------------------
Elements = Output(changeType)
