# Dynamo custom node ToRoom.dyf (Dynamo 2.0.1.5055)
# category: JetPack.Revit.Elements.FamilyInstance.Query

familyInstance = Input(familyInstance: Revit.Elements.FamilyInstance)
select_phase = RevitPhases(index=1)
toRoom = Python(IN[0]=familyInstance, IN[1]=select_phase)  # "FamilyInstance.ToRoom"
# ---------- toRoom.python (5 lines) ----------
instance = UnwrapElement(IN[0])
phase = UnwrapElement(IN[1])


OUT = instance.ToRoom[phase]
# ----------------------------------------
Room = Output(toRoom)
