# Dynamo custom node WallType.FamilyName.dyf (Dynamo 2.0.1.5055)
# category: JetPack.Revit.Elements.Query

wallType = Input(wallType: Revit.Elements.WallType)
python_script = Python(IN[0]=wallType)
# ---------- python_script.python (10 lines) ----------
import clr

# Import RevitAPI
clr.AddReference("RevitAPI")
import Autodesk
from Autodesk.Revit.DB import *

wallType = UnwrapElement(IN[0])

OUT = wallType.FamilyName
# ----------------------------------------
Family_Name = Output(python_script)
