# Dynamo custom node Warnings.dyf (Dynamo 2.0.1.5055)
# category: JetPack.Revit.Query

toggle = Input(toggle: bool = true)
python_script = Python(IN[0]=toggle)
# ---------- python_script.python (43 lines) ----------
import clr
clr.AddReference("RevitServices")
import RevitServices
from RevitServices.Persistence import DocumentManager

clr.AddReference('ProtoGeometry')
from Autodesk.DesignScript.Geometry import *

# Import ToDSType(bool) extension method
clr.AddReference('RevitNodes')
import Revit
clr.ImportExtensions(Revit.Elements)

clr.AddReference("RevitAPI")
clr.AddReference("RevitAPIUI")
import Autodesk
from Autodesk.Revit.UI import *
from Autodesk.Revit.DB import *

from System.Collections.Generic import *


doc = DocumentManager.Instance.CurrentDBDocument
warnings = doc.GetWarnings()

descriptions = []
descriptionsIDs = []
elements = []
elementIDs = []


for w in warnings:
	descriptions.append(w.GetDescriptionText())
	descriptionsIDs.append(w.GetFailureDefinitionId())
	ids = w.GetFailingElements()
	elems = []
	for id in ids:
		elems.append(doc.GetElement(id).ToDSType(True))
	elements.append(elems)
	elementIDs.append(ids)
	
# Just for fun - give it to the output!
OUT = descriptions, elements, warnings
# ----------------------------------------
code_block = CodeBlock(i=python_script) { i[0]; i[1]; i[2]; }
descriptions = Output(code_block.out0)
elements = Output(code_block.out1)
warnings = Output(code_block.out2)
