# Dynamo custom node Worksets.dyf (Dynamo 2.0.1.5055)
# category: JetPack.Revit.Selection

toggle = Input(toggle: bool = true)
python_script = Python(IN[0]=toggle)
# ---------- python_script.python (19 lines) ----------
import clr
clr.AddReference('RevitAPI')
from Autodesk.Revit.DB import *
import Autodesk

clr.AddReference("RevitServices")
import RevitServices
from RevitServices.Persistence import DocumentManager


doc = DocumentManager.Instance.CurrentDBDocument
worksetTable = doc.GetWorksetTable()

ws_coll = FilteredWorksetCollector(doc)
ws_kindes = [ws.Kind.ToString() for ws in ws_coll]
ws_names = [ws.Name for ws in ws_coll]
ws_ids = [ws.Id.IntegerValue for ws in ws_coll]

OUT = [ws_kindes, ws_names, ws_ids, list(ws_coll)]
# ----------------------------------------
code_block = CodeBlock(i=python_script) { kinds = i[0]; names = i[1]; IDs = i[2]; WS = i[3]; }
Kinds = Output(code_block.kinds)
Names = Output(code_block.names)
IDs = Output(code_block.IDs)
Worksets = Output(code_block.WS)
